# Grasshopper definition 01_parallelization.gh (Grasshopper 1.0.7)
# plug-ins: Hops

toggle = BooleanToggle(False)
# [m]
panel = Panel("10")
# [m]
panel_2 = Panel("1")
# [m]
panel_3 = Panel("8")
hops = Hops(
    Trigger=toggle,
    BBOX_SIZE=panel,
    JV_EDGE_SIZE=panel_2,
    MAX_N_JOINTS="400",
    MAX_JOINT_SIZE=panel_3,
    N_simulations="20",
    CacheResultsInMemory=True,
    CacheSolveResults=True,
    RemoteDefinitionLocation="C:\Users\GEr\OneDrive - NGI\Research\Parametric_Rockmass_Studies\src\00_main.gh",
    RemoteSolveVersion=(0, 1, 0),
    ShowInput_Enabled=False,
    ShowInput_Path=False,
    SynchronousSolve=False)
hops_2 = Hops(
    Trigger=toggle,
    BBOX_SIZE=panel,
    JV_EDGE_SIZE=panel_2,
    MAX_N_JOINTS="400",
    MAX_JOINT_SIZE=panel_3,
    N_simulations="20",
    CacheResultsInMemory=True,
    CacheSolveResults=True,
    RemoteDefinitionLocation="C:\Users\GEr\OneDrive - NGI\Research\Parametric_Rockmass_Studies\src\00_main.gh",
    RemoteSolveVersion=(0, 1, 0),
    ShowInput_Enabled=False,
    ShowInput_Path=False,
    SynchronousSolve=False)
hops_3 = Hops(
    Trigger=toggle,
    BBOX_SIZE=panel,
    JV_EDGE_SIZE=panel_2,
    MAX_N_JOINTS="400",
    MAX_JOINT_SIZE=panel_3,
    N_simulations="20",
    CacheResultsInMemory=True,
    CacheSolveResults=True,
    RemoteDefinitionLocation="C:\Users\GEr\OneDrive - NGI\Research\Parametric_Rockmass_Studies\src\00_main.gh",
    RemoteSolveVersion=(0, 1, 0),
    ShowInput_Enabled=False,
    ShowInput_Path=False,
    SynchronousSolve=False)
hops_4 = Hops(
    Trigger=toggle,
    BBOX_SIZE=panel,
    JV_EDGE_SIZE=panel_2,
    MAX_N_JOINTS="400",
    MAX_JOINT_SIZE=panel_3,
    N_simulations="20",
    CacheResultsInMemory=True,
    CacheSolveResults=True,
    RemoteDefinitionLocation="C:\Users\GEr\OneDrive - NGI\Research\Parametric_Rockmass_Studies\src\00_main.gh",
    RemoteSolveVersion=(0, 1, 0),
    ShowInput_Enabled=False,
    ShowInput_Path=False,
    SynchronousSolve=False)
hops_5 = Hops(
    Trigger=toggle,
    BBOX_SIZE=panel,
    JV_EDGE_SIZE=panel_2,
    MAX_N_JOINTS="400",
    MAX_JOINT_SIZE=panel_3,
    N_simulations="20",
    CacheResultsInMemory=True,
    CacheSolveResults=True,
    RemoteDefinitionLocation="C:\Users\GEr\OneDrive - NGI\Research\Parametric_Rockmass_Studies\src\00_main.gh",
    RemoteSolveVersion=(0, 1, 0),
    ShowInput_Enabled=False,
    ShowInput_Path=False,
    SynchronousSolve=False)
hops_6 = Hops(
    Trigger=toggle,
    BBOX_SIZE=panel,
    JV_EDGE_SIZE=panel_2,
    MAX_N_JOINTS="400",
    MAX_JOINT_SIZE=panel_3,
    N_simulations="20",
    CacheResultsInMemory=True,
    CacheSolveResults=True,
    RemoteDefinitionLocation="C:\Users\GEr\OneDrive - NGI\Research\Parametric_Rockmass_Studies\src\00_main.gh",
    RemoteSolveVersion=(0, 1, 0),
    ShowInput_Enabled=False,
    ShowInput_Path=False,
    SynchronousSolve=False)
hops_7 = Hops(
    Trigger=toggle,
    BBOX_SIZE=panel,
    JV_EDGE_SIZE=panel_2,
    MAX_N_JOINTS="400",
    MAX_JOINT_SIZE=panel_3,
    N_simulations="20",
    CacheResultsInMemory=True,
    CacheSolveResults=True,
    RemoteDefinitionLocation="C:\Users\GEr\OneDrive - NGI\Research\Parametric_Rockmass_Studies\src\00_main.gh",
    RemoteSolveVersion=(0, 1, 0),
    ShowInput_Enabled=False,
    ShowInput_Path=False,
    SynchronousSolve=False)
hops_8 = Hops(
    Trigger=toggle,
    BBOX_SIZE=panel,
    JV_EDGE_SIZE=panel_2,
    MAX_N_JOINTS="400",
    MAX_JOINT_SIZE=panel_3,
    N_simulations="20",
    CacheResultsInMemory=True,
    CacheSolveResults=True,
    RemoteDefinitionLocation="C:\Users\GEr\OneDrive - NGI\Research\Parametric_Rockmass_Studies\src\00_main.gh",
    RemoteSolveVersion=(0, 1, 0),
    ShowInput_Enabled=False,
    ShowInput_Path=False,
    SynchronousSolve=False)
hops_9 = Hops(
    Trigger=toggle,
    BBOX_SIZE=panel,
    JV_EDGE_SIZE=panel_2,
    MAX_N_JOINTS="400",
    MAX_JOINT_SIZE=panel_3,
    N_simulations="20",
    CacheResultsInMemory=True,
    CacheSolveResults=True,
    RemoteDefinitionLocation="C:\Users\GEr\OneDrive - NGI\Research\Parametric_Rockmass_Studies\src\00_main.gh",
    RemoteSolveVersion=(0, 1, 0),
    ShowInput_Enabled=False,
    ShowInput_Path=False,
    SynchronousSolve=False)
hops_10 = Hops(
    Trigger=toggle,
    BBOX_SIZE=panel,
    JV_EDGE_SIZE=panel_2,
    MAX_N_JOINTS="400",
    MAX_JOINT_SIZE=panel_3,
    N_simulations="20",
    CacheResultsInMemory=True,
    CacheSolveResults=True,
    RemoteDefinitionLocation="C:\Users\GEr\OneDrive - NGI\Research\Parametric_Rockmass_Studies\src\00_main.gh",
    RemoteSolveVersion=(0, 1, 0),
    ShowInput_Enabled=False,
    ShowInput_Path=False,
    SynchronousSolve=False)
hops_11 = Hops(
    Trigger=toggle,
    BBOX_SIZE=panel,
    JV_EDGE_SIZE=panel_2,
    MAX_N_JOINTS="400",
    MAX_JOINT_SIZE=panel_3,
    N_simulations="20",
    CacheResultsInMemory=True,
    CacheSolveResults=True,
    RemoteDefinitionLocation="C:\Users\GEr\OneDrive - NGI\Research\Parametric_Rockmass_Studies\src\00_main.gh",
    RemoteSolveVersion=(0, 1, 0),
    ShowInput_Enabled=False,
    ShowInput_Path=False,
    SynchronousSolve=False)
hops_12 = Hops(
    Trigger=toggle,
    BBOX_SIZE=panel,
    JV_EDGE_SIZE=panel_2,
    MAX_N_JOINTS="400",
    MAX_JOINT_SIZE=panel_3,
    N_simulations="20",
    CacheResultsInMemory=True,
    CacheSolveResults=True,
    RemoteDefinitionLocation="C:\Users\GEr\OneDrive - NGI\Research\Parametric_Rockmass_Studies\src\00_main.gh",
    RemoteSolveVersion=(0, 1, 0),
    ShowInput_Enabled=False,
    ShowInput_Path=False,
    SynchronousSolve=False)
hops_13 = Hops(
    Trigger=toggle,
    BBOX_SIZE=panel,
    JV_EDGE_SIZE=panel_2,
    MAX_N_JOINTS="400",
    MAX_JOINT_SIZE=panel_3,
    N_simulations="20",
    CacheResultsInMemory=True,
    CacheSolveResults=True,
    RemoteDefinitionLocation="C:\Users\GEr\OneDrive - NGI\Research\Parametric_Rockmass_Studies\src\00_main.gh",
    RemoteSolveVersion=(0, 1, 0),
    ShowInput_Enabled=False,
    ShowInput_Path=False,
    SynchronousSolve=False)
hops_14 = Hops(
    Trigger=toggle,
    BBOX_SIZE=panel,
    JV_EDGE_SIZE=panel_2,
    MAX_N_JOINTS="400",
    MAX_JOINT_SIZE=panel_3,
    N_simulations="20",
    CacheResultsInMemory=True,
    CacheSolveResults=True,
    RemoteDefinitionLocation="C:\Users\GEr\OneDrive - NGI\Research\Parametric_Rockmass_Studies\src\00_main.gh",
    RemoteSolveVersion=(0, 1, 0),
    ShowInput_Enabled=False,
    ShowInput_Path=False,
    SynchronousSolve=False)
hops_15 = Hops(
    Trigger=toggle,
    BBOX_SIZE=panel,
    JV_EDGE_SIZE=panel_2,
    MAX_N_JOINTS="400",
    MAX_JOINT_SIZE=panel_3,
    N_simulations="20",
    CacheResultsInMemory=True,
    CacheSolveResults=True,
    RemoteDefinitionLocation="C:\Users\GEr\OneDrive - NGI\Research\Parametric_Rockmass_Studies\src\00_main.gh",
    RemoteSolveVersion=(0, 1, 0),
    ShowInput_Enabled=False,
    ShowInput_Path=False,
    SynchronousSolve=False)
hops_16 = Hops(
    Trigger=toggle,
    BBOX_SIZE=panel,
    JV_EDGE_SIZE=panel_2,
    MAX_N_JOINTS="400",
    MAX_JOINT_SIZE=panel_3,
    N_simulations="20",
    CacheResultsInMemory=True,
    CacheSolveResults=True,
    RemoteDefinitionLocation="C:\Users\GEr\OneDrive - NGI\Research\Parametric_Rockmass_Studies\src\00_main.gh",
    RemoteSolveVersion=(0, 1, 0),
    ShowInput_Enabled=False,
    ShowInput_Path=False,
    SynchronousSolve=False)
hops_17 = Hops(
    Trigger=toggle,
    BBOX_SIZE=panel,
    JV_EDGE_SIZE=panel_2,
    MAX_N_JOINTS="400",
    MAX_JOINT_SIZE=panel_3,
    N_simulations="20",
    CacheResultsInMemory=True,
    CacheSolveResults=True,
    RemoteDefinitionLocation="C:\Users\GEr\OneDrive - NGI\Research\Parametric_Rockmass_Studies\src\00_main.gh",
    RemoteSolveVersion=(0, 1, 0),
    ShowInput_Enabled=False,
    ShowInput_Path=False,
    SynchronousSolve=False)
hops_18 = Hops(
    Trigger=toggle,
    BBOX_SIZE=panel,
    JV_EDGE_SIZE=panel_2,
    MAX_N_JOINTS="400",
    MAX_JOINT_SIZE=panel_3,
    N_simulations="20",
    CacheResultsInMemory=True,
    CacheSolveResults=True,
    RemoteDefinitionLocation="C:\Users\GEr\OneDrive - NGI\Research\Parametric_Rockmass_Studies\src\00_main.gh",
    RemoteSolveVersion=(0, 1, 0),
    ShowInput_Enabled=False,
    ShowInput_Path=False,
    SynchronousSolve=False)
hops_19 = Hops(
    Trigger=toggle,
    BBOX_SIZE=panel,
    JV_EDGE_SIZE=panel_2,
    MAX_N_JOINTS="400",
    MAX_JOINT_SIZE=panel_3,
    N_simulations="20",
    CacheResultsInMemory=True,
    CacheSolveResults=True,
    RemoteDefinitionLocation="C:\Users\GEr\OneDrive - NGI\Research\Parametric_Rockmass_Studies\src\00_main.gh",
    RemoteSolveVersion=(0, 1, 0),
    ShowInput_Enabled=False,
    ShowInput_Path=False,
    SynchronousSolve=False)
hops_20 = Hops(
    Trigger=toggle,
    BBOX_SIZE=panel,
    JV_EDGE_SIZE=panel_2,
    MAX_N_JOINTS="400",
    MAX_JOINT_SIZE=panel_3,
    N_simulations="20",
    CacheResultsInMemory=True,
    CacheSolveResults=True,
    RemoteDefinitionLocation="C:\Users\GEr\OneDrive - NGI\Research\Parametric_Rockmass_Studies\src\00_main.gh",
    RemoteSolveVersion=(0, 1, 0),
    ShowInput_Enabled=False,
    ShowInput_Path=False,
    SynchronousSolve=False)
